# Grasshopper definition FlatNozzle_adaptive_rotation.gh (Grasshopper 1.0.4)
# plug-ins: Pufferfish

points_count = Slider(12, range=0..100)
crv = Curve(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)
crv_2 = Curve(<curve referenced from the Rhino model>)
hframes = HorizontalFrames(Curve=crv_2, Count=points_count)  # -> Frames, Parameters
eval = EvaluateCurve(Curve=crv_2, Parameter=hframes.Parameters)  # -> Point, Tangent, Angle

brep = Brep(<brep referenced from the Rhino model>)
volume = Volume(Geometry=brep)  # -> Volume, Centroid
mesh = Mesh(brep)
move2pt = MoveToPoint(Geometry=mesh, PointA=volume.Centroid, PointB=eval.Point)  # -> Moved, Vector, Transform

vdis = VectorDisplay(Anchor=eval.Point, Vector=eval.Tangent)
panel = Panel(eval.Angle)

# ---- group: Dir Vec
deplane = DeconstructPlane(Plane=hframes.Frames)  # -> Origin, XAxis, YAxis, ZAxis
vec = VectorXYZ(XComponent=deplane.XAxis, YComponent=0, ZComponent=0)  # -> Vector, Length
amp = Amplitude(Vector=vec.Vector, Amplitude=Slider(3, range=0..100))
vdis_2 = VectorDisplay(Anchor=deplane.Origin, Vector=amp)

# ---- group: Tan display
divide = DivideCurve(Curve=crv_2, Count=points_count, Kinks=False)  # -> Points, Tangents, Parameters
amp_2 = Amplitude(Vector=divide.Tangents, Amplitude=Slider(6, range=0..100))
vdis_3 = VectorDisplay(Anchor=divide.Points, Vector=amp_2)

# ----
replace = ReplaceItems(List=divide.Tangents, Item="{1,0,0}", Indices=0, Wrap=False)
vdis_4 = VectorDisplay(Anchor=deplane.Origin, Vector=deplane.YAxis)
rectangle = Rectangle(Plane=hframes.Frames, XSize=Domain(-1, 1), YSize=Domain(-2, 2), Radius=0)  # -> Rectangle, Length
shift = ShiftList(List=replace, Shift=1, Wrap=True)
boundary = BoundarySurfaces(Edges=rectangle.Rectangle)
deplane_2 = DeconstructPlane(Plane=hframes.Frames)  # -> Origin, XAxis, YAxis, ZAxis
python = GhPythonScript(x=replace, y=shift)  # -> out, a; inputs x: list of Vector3d, y: list of Vector3d
# ---------- python: Python ----------
import Rhino.Geometry as rg

a = []
for xi, yi in zip(x, y):
    angle = rg.Vector3d.VectorAngle(xi, yi)
    a.append(angle)
# ---------- end python ----------
vdis_5 = VectorDisplay(Anchor=deplane_2.Origin, Vector=deplane_2.YAxis)
move_nozzle = Slider(5, range=0..100)
item = ListItem(List=rectangle.Rectangle, Index=move_nozzle, Wrap=True)
area = Area(Geometry=item)  # -> Area, Centroid
deg = Degrees(Radians=python.a)
relative_change_e = Panel(deg)
ma = MassAddition(Input=relative_change_e)  # -> Result, PartialResults
ins = InsertItems(List=ma.PartialResults, Item="53.234", Indices=0, Wrap=True)
panel_2 = Panel(ins)

# ---- group: Nozzle Mesh
brep_2 = Brep(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)
volume_2 = Volume(Geometry=brep_2)  # -> Volume, Centroid
mesh_2 = Mesh(brep_2)
move2pt_2 = MoveToPoint(Geometry=mesh_2, PointA=volume_2.Centroid, PointB=area.Centroid)  # -> Moved, Vector, Transform

# ----
angle = Angle(VectorA=amp_2, VectorB=amp)  # -> Angle, Reflex
python_2 = GhPythonScript(x=deg, init_angle=Slider(0, range=0..100))  # -> out, a; inputs x: list
# ---------- python_2: Python ----------
fin_dirs = []
a = []
s = 0
clockwise = True

#for idx, val, in enumerate(x):
#    if (idx < len(x) - 1) and val < x[idx+1]:
#        val = -val
#    fin_dirs.append(val)
#print(fin_dirs)

a.append(53.234)
for i in x:
    s = s  + i
    a.append(s)
# ---------- end python_2 ----------

# ---- group: Flip angle
item_2 = ListItem(List=angle.Reflex, Index=move_nozzle, Wrap=True)
deg_2 = Degrees(Radians=angle.Angle)

# ----
pdecon = Deconstruct(Point=flatten(divide.Points))  # -> XComponent, YComponent, ZComponent
multiplication = Multiplication(A="20", B="60")
multiplication_2 = Multiplication(A=deg_2, B="0.025")
concat = Concatenate(
    FragmentA="G1",
    FragmentB=" F",
    FragmentC=multiplication,
    FragmentD=" X",
    FragmentE=pdecon.XComponent,
    FragmentF=" Y",
    FragmentG=pdecon.YComponent,
    FragmentH=" Z",
    FragmentI=pdecon.ZComponent,
    FragmentJ=" E",
    FragmentK=multiplication_2)
merge = Merge(Data2=concat)
panel_3 = Panel(merge)

target_angles = Panel("""53.234
74.610206
179.39955
289.414907
306.707861
327.729612
436.410778
538.849144
560.309024
613.415721""")

# ---- group: Viz Nozzle
Z = UnitZ(Factor=Slider(6, range=0..100))
move = Move(Geometry=move2pt_2.Moved, Motion=Z)  # -> Geometry, Transform
rotate = Rotate(Geometry=move.Geometry, Angle=item_2, Plane=area.Centroid)  # -> Geometry, Transform
preview = CustomPreview(Geometry=rotate.Geometry, Material=ColourSwatch(SwatchColor=RGB(157, 26, 186)))

# ----
panel_4 = Panel(deg_2)
orient = OrientDirection(Geometry=brep_2, PointA=Point(0, 0, 0), DirectionA=Vector(20, 0, 0), PointB=deplane_2.Origin, DirectionB=deplane_2.XAxis)  # -> Geometry, Transform
pi = Pi(Factor="2")
item_3 = ListItem(List=target_angles, Index=move_nozzle, Wrap=True)
deg_3 = Degrees(Radians=pi)
panel_5 = Panel(deg_3)
deg_4 = Degrees(Radians=angle.Angle)
tag = TextTag3D(Location=hframes.Frames, Text=deg_4, Size=1, Colour=ColourSwatch(SwatchColor=RGB(255, 255, 255)), Justification=7)

# ---- group: Ideal Angle
number_slider = Slider(60, range=-180..361)
Z_2 = UnitZ(Factor=Slider(12, range=0..100))
item_4 = ListItem(List=item_3, Index=move_nozzle, Wrap=True)
move_2 = Move(Geometry=move2pt_2.Moved, Motion=Z_2)  # -> Geometry, Transform
rotate_2 = Rotate(Geometry=move_2.Geometry, Angle=degrees(item_4), Plane=area.Centroid)  # -> Geometry, Transform
preview_2 = CustomPreview(
    Geometry=rotate_2.Geometry,
    Material={diffuse=RGB(221, 160, 221), emission=RGB(66, 48, 66), shine=0.5, specular=RGB(255, 255, 255), transparency=0})

# ----
addition = Addition(A=number_slider, B=Slider(226, range=-180..361))

# ---- group: Ideal Angle (continued)
rad = Radians(Degrees=addition)
