# Grasshopper definition FlatNozzle_adaptive_rotation_from_scratch.gh (Grasshopper 1.0.4)
# plug-ins: Pufferfish

crv = Curve(<curve referenced from the Rhino model>)
hframes = HorizontalFrames(Curve=crv, Count=Slider(30, range=0..100))  # -> Frames, Parameters
deplane = DeconstructPlane(Plane=hframes.Frames)  # -> Origin, XAxis, YAxis, ZAxis
ins = InsertItems(List=deplane.XAxis, Item="{1,0,0}", Indices=0, Wrap=True)
cull_i = CullIndex(List=ins, Indices=-1, Wrap=True)  # -> flatten(List)
black_vec = Panel(cull_i)

# ---- group: Viz vectors
number_slider = Slider(0, range=0..12)
swatch = ColourSwatch(SwatchColor=RGB(51, 12, 12))
swatch_2 = ColourSwatch(SwatchColor=RGB(255, 255, 255))
amp = Amplitude(Vector=black_vec, Amplitude=3)
item = ListItem(List=amp, Index=number_slider, Wrap=True)
amp_2 = Amplitude(Vector=deplane.XAxis, Amplitude=3)
item_2 = ListItem(List=amp_2, Index=number_slider, Wrap=True)
vdisex = VectorDisplayEx(Point=deplane.Origin, Vector=amp, Colour=swatch, Width=3)
vdisex_2 = VectorDisplayEx(Point=deplane.Origin, Vector=amp_2, Colour=swatch_2, Width=3)
vdisex_3 = VectorDisplayEx(Point=Point(0, 0, 0), Vector=item_2, Colour=swatch_2, Width=3)
vdisex_4 = VectorDisplayEx(Point=Point(0, 0, 0), Vector=item, Colour=swatch, Width=3)

# ----
mesh = Mesh(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)
pt = Point(Point(0, 0, 0))
move_nozzle = Slider(0, range=0..50)

# ---- group: Viz basis
item_3 = ListItem(List=deplane.XAxis, Index=move_nozzle, Wrap=True)
vec = Vector(Vector(25, 0, 0))
pl = ConstructPlane(Origin=deplane.Origin, XAxis=Vector(1, 0, 0), YAxis=Vector(0, 1, 0))
amp_3 = Amplitude(Vector=item_3, Amplitude=10)
preview = CustomPreview(Geometry=pl, Material=ColourSwatch(SwatchColor=RGB(12, 5, 94)))
vdis = VectorDisplay(Anchor=pt, Vector=vec)
vdis_2 = VectorDisplay(Anchor=pt, Vector=amp_3)

# ----
angle = Angle(VectorA=deplane.XAxis, VectorB=black_vec, Plane=deplane.Origin)  # -> Angle, Reflex

# ---- group: Inflection points
vb = DotNETVBScriptLEGACY(crv=crv)  # -> print, arrayinflectionpt
# ---------- vb: VB ----------
    
    Dim inflectionpt As New List (Of on3dpoint)
    Dim rhCurve As IOnCurve = crv
    'If (rhCurve Is Nothing) Then Return IRhinoCommand.result.cancel

    Dim nInflectionSolver As New InflectionFinder(rhCurve)
    Dim nInflectionCount As Int32 = nInflectionSolver.Inflections.Count

    If (nInflectionCount = 0) Then
      Print("No inflection points found on curve" & vbCrLf)
    Else
      Print(nInflectionCount & " inflection points found on curve" & vbCrLf)

      For Each ptInflection As CurveInflection In nInflectionSolver.Inflections
        inflectionpt.add(ptInflection.Point)
        
      Next
    End If
    arrayinflectionpt = inflectionpt
# ---------- vb: VB additional code ----------
  
  
  Public Class InflectionFinder
    Protected m_Curve As OnNurbsCurve
    Protected m_Inflections As New List(Of CurveInflection)

    #Region "Construction"
    Public Sub New(ByVal iCurve As IOnCurve)
      If (iCurve Is Nothing) Then
        Throw New Exception("CInflectionFinder can only be constructed with a proper OnCurve reference")
      End If

      Me.m_Curve = New OnNurbsCurve
      If (iCurve.GetNurbForm(Me.m_Curve, RMA.Rhino.RhUtil.RhinoApp.ActiveDoc.AbsoluteTolerance) = 0) Then
        Throw New Exception("CInflectionFinder constructor failed to create a valid Nurbs curve from the input")
      End If

      Me.CalculateAllInflections()
    End Sub
    #End Region

    #Region "Properties"
    Public ReadOnly Property Inflections() As List(Of CurveInflection)
      Get
        Return Me.m_Inflections
      End Get
    End Property
    #End Region

    #Region "Inflection logic"
    Protected Sub CalculateAllInflections()
      Me.m_Inflections.Clear()

      Dim cSpan As New List(Of CurveSpan)
      Me.AppendSpanIntervals(cSpan)

      If (cSpan.Count = 0) Then Return

      For Each Span As CurveSpan In cSpan
        If (Me.IsSegmentLinear(Span)) Then Continue For
        Me.SolveInflections(Span)
      Next
    End Sub

    'Protected Sub AppendSpanIntervals(ByVal cList As List(Of CurveSpan))
    '  cList.Clear()

    '  Dim kPrev As Double = Me.m_Curve.Knot(0)
    '  Dim k As Double = Double.NaN

    '  For i As Int32 = 1 To Me.m_Curve.KnotCount - 1
    '    k = Me.m_Curve.Knot(i)

    '    If (k > kPrev) Then
    '      cList.Add(New CurveSpan(kPrev, k))
    '      kPrev = k
    '    End If
    '  Next
    'End Sub
    Protected Sub AppendSpanIntervals(ByVal cList As List(Of CurveSpan))
      cList.Clear()

      Dim kPrev As Double = Me.m_Curve.Knot(0)
      Dim k As Double = Double.NaN

      For i As Int32 = 1 To Me.m_Curve.KnotCount - 1
        k = Me.m_Curve.Knot(i)

        If (k > kPrev) Then
          If (Me.m_Curve.Degree < 4) Then
            'Degree 3 and less can only have 1 inflection point per span, we can afford to be coarse
            cList.Add(New CurveSpan(kPrev, k))
          Else
            'Degree 4 and above can have multiple inflections per span, we have to be careful
            Dim jStep As Double = 0.005 * (k - kPrev)

            For j As Double = kPrev To k - (0.5 * jStep) Step jStep
              cList.Add(New CurveSpan(j, j + jStep))
            Next
          End If

          kPrev = k
        End If
      Next
    End Sub

    Protected Const epsilon As Double = 1.0E-20
    Protected Const spanstep As Double = 0.1

    Protected Function SolveInflections(ByVal Span As CurveSpan, Optional ByVal depth As Int32 = 0) As Boolean
      If (depth > 25) Then
        RMA.Rhino.RhUtil.RhinoApp.Print("Inflection routine aborted due to excessive recursion depth..." & vbCrLf)
        Return False
      End If

      Dim rc As Boolean = False

      Dim kappa0 As Double = Double.NaN
      Dim kappa1 As Double = Double.NaN

      Dim prev_inflection As CurveInflection = Nothing
      Dim kappa_hint As New On3dVector(0, 0, 0)

      Dim c_param As Double

      For t As Double = 0.0 To (1.0 + (0.1 * spanstep)) Step spanstep
        c_param = Span.ValueAt(t)
        kappa0 = kappa1

        If (t = 0.0) Then
          kappa1 = Me.SolveInflectionAmplitude(c_param, kappa_hint, +1)
        Else
          kappa1 = Me.SolveInflectionAmplitude(c_param, kappa_hint, -1)
        End If

        If (Double.IsNaN(kappa1)) Then Continue For

        If (Math.Abs(kappa1) < epsilon) Then
          Dim pInflection As New CurveInflection(c_param, kappa1, Me.m_Curve.PointAt(c_param), Me.m_Curve.TangentAt(c_param))

          If (prev_inflection Is Nothing) Then
            Me.m_Inflections.Add(pInflection)
            prev_inflection = pInflection
          Else
            If (Math.Abs(prev_inflection.Kappa) < Math.Abs(kappa1)) Then
              'The previous point was more accurate, ignore this solution
              Continue For
            Else
              'This point is more accurate, remove the previous solution
              Me.m_Inflections.RemoveAt(Me.m_Inflections.Count - 1)

              Me.m_Inflections.Add(pInflection)
              prev_inflection = pInflection
            End If
          End If

          rc = True
          Continue For
        End If

        prev_inflection = Nothing

        If (Double.IsNaN(kappa0)) Then Continue For

        If (Math.Sign(kappa1) <> Math.Sign(kappa0)) AndAlso (Math.Abs(kappa0) > epsilon) Then
          'we have opposing signs, there is an inflection point in between kPrev and k
          rc = rc And SolveInflections(Span.SubSet(t - spanstep, t), depth + 1)
        End If
      Next

      Return rc
    End Function

    Protected Function SolveInflectionAmplitude(ByVal t As Double, ByRef hint As On3dVector, ByVal side As Int32) As Double
      Dim ev_pt As New On3dPoint
      Dim ev_tan As New On3dVector
      Dim ev_kappa As New On3dVector

      If Me.m_Curve.EvCurvature(t, ev_pt, ev_tan, ev_kappa, side) Then
        If (hint.IsZero) Then hint.Set(ev_kappa.x, ev_kappa.y, ev_kappa.z)

        Dim fSign As Int32 = +1
        If (ev_kappa.IsParallelTo(hint, 0.5 * Math.PI) < 0) Then fSign = -1

        hint.Set(ev_kappa.x, ev_kappa.y, ev_kappa.z)
        Return fSign * ev_kappa.LengthSquared()

      Else
        Return Double.NaN
      End If
    End Function
    Protected Function IsSegmentLinear(ByVal Span As CurveSpan) As Boolean
      Dim lSegment As New OnLine(Me.m_Curve.PointAt(Span.A), Me.m_Curve.PointAt(Span.B))
      Dim linearity_accuracy As Double = 0.0000000001

      If (lSegment.DistanceTo(Me.m_Curve.PointAt(Span.ValueAt(0.2))) > linearity_accuracy) Then Return False
      If (lSegment.DistanceTo(Me.m_Curve.PointAt(Span.ValueAt(0.5))) > linearity_accuracy) Then Return False
      If (lSegment.DistanceTo(Me.m_Curve.PointAt(Span.ValueAt(0.8))) > linearity_accuracy) Then Return False

      Return True
    End Function
    #End Region
  End Class

  Public Class CurveSpan
    Protected m_Span As OnInterval

    Public Sub New(ByVal dFrom As Double, ByVal dTo As Double)
      Me.m_Span = New OnInterval(dFrom, dTo)
    End Sub
    Public Sub New(ByVal nSpan As CurveSpan)
      Me.m_Span = New OnInterval(nSpan.m_Span)
    End Sub

    Public Property Span() As OnInterval
      Get
        Return Me.m_Span
      End Get
      Set(ByVal value As OnInterval)
        Me.m_Span = value
      End Set
    End Property
    Public Property A() As Double
      Get
        Return Me.m_Span.m_t(0)
      End Get
      Set(ByVal value As Double)
        Me.m_Span.m_t(0) = value
      End Set
    End Property
    Public Property B() As Double
      Get
        Return Me.m_Span.m_t(1)
      End Get
      Set(ByVal value As Double)
        Me.m_Span.m_t(1) = value
      End Set
    End Property
    Public Function ValueAt(ByVal t As Double) As Double
      Return Me.m_Span.m_t(0) + t * (Me.m_Span.m_t(1) - Me.m_Span.m_t(0))
    End Function

    Public Function SubSet(ByVal t0 As Double, ByVal t1 As Double) As CurveSpan
      Return New CurveSpan(Me.ValueAt(t0), Me.ValueAt(t1))
    End Function
  End Class

  Public Class CurveInflection
    Protected m_Parameter As Double
    Protected m_Kappa As Double

    Protected m_Point As On3dPoint
    Protected m_Tangent As On3dVector

    Public Sub New(ByVal nParameter As Double, _
      ByVal nKappa As Double, _
      ByVal nPoint As IOn3dPoint, _
      ByVal nTangent As IOn3dVector)

      Me.m_Parameter = nParameter
      Me.m_Kappa = nKappa
      Me.m_Point = New On3dPoint(nPoint)
      Me.m_Tangent = New On3dVector(nTangent)
    End Sub

    Public ReadOnly Property Point() As On3dPoint
      Get
        Return Me.m_Point
      End Get
    End Property
    Public ReadOnly Property Tangent() As On3dVector
      Get
        Return Me.m_Point
      End Get
    End Property
    Public ReadOnly Property Parameter() As Double
      Get
        Return Me.m_Parameter
      End Get
    End Property
    Public ReadOnly Property Kappa() As Double
      Get
        Return Me.m_Kappa
      End Get
    End Property
  End Class
# ---------- end vb ----------
crv_cp = CurveClosestPoint(Point=vb.arrayinflectionpt, Curve=crv)  # -> Point, Parameter, Distance
msphere = MeshSphere(Base=vb.arrayinflectionpt, Radius=2, UCount=10, VCount=20)

# ----
move2pt = MoveToPoint(Geometry=mesh, PointA=pt, PointB=deplane.Origin)  # -> Moved, Vector, Transform
angle_2 = Angle(VectorA=deplane.XAxis, VectorB=black_vec)  # -> Angle, Reflex
python = GhPythonScript(angles=angle.Angle, b_vecs=black_vec)  # -> out, new_vecs, flatten(dirs); inputs angles: list, b_vecs: list of Vector3d
# ---------- python: Python ----------
import math
import Rhino.Geometry as rg

new_vecs = []
dirs = []

def calc_kat(vec, a):
    new_x = vec.Length * math.sin(a)
    new_y = vec.Length * math.sin(math.pi/2 - a)
    return rg.Vector3d(new_x, new_y, 0)

def get_dir(vec):
    dir = "CCW"
    if vec.X >= 0:
        dir = "CW"
    return dir

for vec, a in zip(b_vecs, angles):
    new_x = calc_kat(vec, a)
    new_vecs.append(new_x)
    dirs.append(get_dir(new_x))
# ---------- end python ----------
deg = Degrees(Radians=angle_2.Angle)
dangles_for_g_code_w_0_dir = Panel(deg)
directions = Panel(python.dirs)
python_2 = GhPythonScript(pts=deplane.Origin, angles=deg, pts_dir=directions)  # -> out, a; inputs pts: list of Point3d, angles: list, pts_dir: list
# ---------- python_2: Python ----------
new_angles = []

for pt, angle, dir in zip(pts, angles, pts_dir):
    if dir == "CCW":
        a = -angle
    else:
        a = angle
    new_angles.append(a)

a = new_angles
# ---------- end python_2 ----------
ma = MassAddition(Input=python_2.a)  # -> Result, flatten(PartialResults)
angles_for_visual = Panel(ma.PartialResults)
dangles_for_g_code_w_dirs = Panel(python_2.a)
item_4 = ListItem(List=move2pt.Moved, Index=move_nozzle, Wrap=True)
item_5 = ListItem(List=angles_for_visual, Index=move_nozzle, Wrap=True)
item_6 = ListItem(List=deplane.Origin, Index=move_nozzle, Wrap=True)
rotate = Rotate(Geometry=item_4, Angle=expr("360-x", degrees(item_5)), Plane=item_6)  # -> Geometry, Transform

# ---- group: G-cod generator [M83 relative E mode]
feed_rate = Slider(20, range=0..100)
panel = Panel("""M107
M104 S200 ; set temperature
;G28 ; home all axes
G1 Z5 F5000 ; lift nozzle
M109 S200 ; set temperature and wait for it to be reached
G21 ; set units to millimeters
G90 ; use absolute coordinates
M83 ; use relative mode for extrusion
G92 E0 ; requires nozzle to be positioned at zero
;START""")
panel_2 = Panel(""";END
M104 S0 ; turn off temperature
M84     ; disable motors""")
pdecon = Deconstruct(Point=flatten(deplane.Origin))  # -> XComponent, YComponent, ZComponent
e_mm_degree = Panel("0.025")
multiplication = Multiplication(A=dangles_for_g_code_w_dirs, B=e_mm_degree)
multiplication_2 = Multiplication(A=feed_rate, B="60")
python_3 = GhPythonScript(
    FR=multiplication_2,
    X=pdecon.XComponent,
    Y=pdecon.YComponent,
    Z=pdecon.ZComponent,
    E=multiplication,
    start=panel,
    end=panel_2)  # -> out, gcode; inputs FR: Int32, X: list, Y: list, Z: list, E: list, start: list, end: list
# ---------- python_3: Python ----------
gcode = []

for x, y, z, e in zip(X, Y, Z, E):
    gcode.append("G1 F{0} X{1} Y{2} Z{3} E{4}".format(FR, x, y, z, -e))

gcode = start + gcode + end
# ---------- end python_3 ----------
final_g_code = Panel(python_3.gcode)

# ----
preview_2 = CustomPreview(
    Geometry=rotate.Geometry,
    Material={diffuse=RGB(221, 160, 221), emission=RGB(66, 48, 66), shine=0.5, specular=RGB(255, 255, 255), transparency=0})
