# Grasshopper definition GCodeForTubularNozzle.gh (Grasshopper 1.0.7)

crv = Curve(<curve referenced from the Rhino model>)
divide = DivideCurve(Curve=crv, Count=20, Kinks=False)  # -> Points, Tangents, Parameters

cp = ControlPoints(Curve=crv)  # -> Points, Weights, Knots
explode = Explode(Curve=crv, Recursive=True)  # -> Segments, Vertices
len = Length(Curve=explode.Segments)
panel = Panel(divide.Points)
ins = InsertItems(List=len, Item="0", Indices="0", Wrap=True)
ma = MassAddition(Input=flatten(ins))  # -> Result, PartialResults
pdecon = Deconstruct(Point=flatten(panel))  # -> XComponent, YComponent, ZComponent
multiplication = Multiplication(A="20", B="60")
panel_2 = Panel(ma.PartialResults)
multiplication_2 = Multiplication(A=panel_2)
concat = Concatenate(
    FragmentA="G1",
    FragmentB=" F",
    FragmentC=multiplication,
    FragmentD=" X",
    FragmentE=pdecon.XComponent,
    FragmentF=" Y",
    FragmentG=pdecon.YComponent,
    FragmentH=" Z",
    FragmentI=pdecon.ZComponent,
    FragmentJ=" E",
    FragmentK=multiplication_2)

panel_3 = Panel("""M107
M104 S200 ; set temperature
;G28 ; home all axes
G1 Z5 F5000 ; lift nozzle
M109 S200 ; set temperature and wait for it to be reached
G21 ; set units to millimeters
G90 ; use absolute coordinates
M83 ; use relative mode for extrusion
G92 E0 ; requires nozzle to be positioned at zero
;START""")
panel_4 = Panel(""";END
M104 S0 ; turn off temperature
M84     ; disable motors""")
merge = Merge(Data1=panel_3, Data2=concat, Data3=panel_4)
panel_5 = Panel(merge)
