# Grasshopper definition Multilayer_shell_slicer.gh (Grasshopper 1.0.7)
# plug-ins: Pufferfish

layer_number = Slider(1, range=0..2)
layer_height = Slider(10, range=0..10)
move_nozzle = Slider(0, range=0..50)
brep = Brep(<brep referenced from the Rhino model>)
contour = Contour(Shape=brep, Point=Point(0, 0, 0), Direction=Vector(0, 0, 1), Distance=layer_height)
expression = Expression(x=layer_number, Expression="Format(\"0;{0};0\", x)")
hframes = HorizontalFrames(Curve=contour, Count=Slider(12, range=0..100))  # -> Frames, Parameters
deplane = DeconstructPlane(Plane=hframes.Frames)  # -> Origin, XAxis, YAxis, ZAxis
ins = InsertItems(List=deplane.XAxis, Item="{1,0,0}", Indices=0, Wrap=True)
cull_i = CullIndex(List=ins, Indices=-1, Wrap=True)  # -> flatten(List)
branch = TreeBranch(Tree=deplane.Origin, Path=expression, MaintainPaths=True)
black_vec = Panel(cull_i)
mesh = Mesh(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)
pt = Point(Point(0, 0, 0))
angle = Angle(VectorA=deplane.XAxis, VectorB=black_vec, Plane=deplane.Origin)  # -> Angle, Reflex
move2pt = MoveToPoint(Geometry=mesh, PointA=pt, PointB=branch)  # -> Moved, Vector, Transform
angle_2 = Angle(VectorA=deplane.XAxis, VectorB=black_vec)  # -> Angle, Reflex
python = GhPythonScript(angles=angle.Angle, b_vecs=black_vec)  # -> out, new_vecs, dirs; inputs angles: list, b_vecs: list of Vector3d
# ---------- python: Python ----------
import math
import Rhino.Geometry as rg

new_vecs = []
dirs = []

def calc_kat(vec, a):
    new_x = vec.Length * math.sin(a)
    new_y = vec.Length * math.sin(math.pi/2 - a)
    return rg.Vector3d(new_x, new_y, 0)

def get_dir(vec):
    dir = "CCW"
    if vec.X >= 0:
        dir = "CW"
    return dir

for vec, a in zip(b_vecs, angles):
    new_x = calc_kat(vec, a)
    new_vecs.append(new_x)
    dirs.append(get_dir(new_x))
# ---------- end python ----------
deg = Degrees(Radians=angle_2.Angle)
dangles_for_g_code_w_0_dir = Panel(deg)
directions = Panel(python.dirs)
python_2 = GhPythonScript(pts=deplane.Origin, angles=deg, pts_dir=directions)  # -> out, a; inputs pts: list of Point3d, angles: list, pts_dir: list
# ---------- python_2: Python ----------
new_angles = []

for pt, angle, dir in zip(pts, angles, pts_dir):
    if dir == "CCW":
        a = -angle
    else:
        a = angle
    new_angles.append(a)

a = new_angles
# ---------- end python_2 ----------
ma = MassAddition(Input=python_2.a)  # -> Result, flatten(PartialResults)
dangles_for_g_code_w_dirs = Panel(python_2.a)
angles_for_visual = Panel(ma.PartialResults)
item = ListItem(List=move2pt.Moved, Index=move_nozzle, Wrap=True)
item_2 = ListItem(List=angles_for_visual, Index=move_nozzle, Wrap=True)
item_3 = ListItem(List=branch, Index=move_nozzle, Wrap=True)

# ---- group: G-cod generator [M83 relative E mode]
feed_rate = Slider(20, range=0..100)
panel = Panel("""M107
M104 S200 ; set temperature
;G28 ; home all axes
G1 Z5 F5000 ; lift nozzle
M109 S200 ; set temperature and wait for it to be reached
G21 ; set units to millimeters
G90 ; use absolute coordinates
M83 ; use relative mode for extrusion
G92 E0 ; requires nozzle to be positioned at zero
;START""")
panel_2 = Panel(""";END
M104 S0 ; turn off temperature
M84     ; disable motors""")
pdecon = Deconstruct(Point=deplane.Origin)  # -> simplify(flatten(XComponent)), simplify(flatten(YComponent)), simplify(flatten(ZComponent))
e_mm_degree = Panel("0.025")
multiplication = Multiplication(A=dangles_for_g_code_w_dirs, B=e_mm_degree)  # -> flatten(Result)
multiplication_2 = Multiplication(A=feed_rate, B="60")
python_3 = GhPythonScript(
    FR=multiplication_2,
    X=pdecon.XComponent,
    Y=pdecon.YComponent,
    Z=pdecon.ZComponent,
    E=multiplication,
    start=panel,
    end=panel_2)  # -> out, gcode; inputs FR: Int32, X: list, Y: list, Z: list, E: list, start: list, end: list
# ---------- python_3: Python ----------
import ghpythonlib.treehelpers as th

gcode = []

#X = th.tree_to_list(X)
#Y = th.tree_to_list(Y)
#Z = th.tree_to_list(Z)
#E = th.tree_to_list(E)

for x, y, z, e in zip(X, Y, Z, E):
    gcode.append("G1 F{0} X{1} Y{2} Z{3} E{4}".format(FR, x, y, z, -e))

gcode = start + gcode + end
# ---------- end python_3 ----------
final_g_code = Panel(python_3.gcode)

# ----
rotate = Rotate(Geometry=item, Angle=expr("360-x", degrees(item_2)), Plane=item_3)  # -> Geometry, Transform
preview = CustomPreview(
    Geometry=rotate.Geometry,
    Material={diffuse=RGB(221, 160, 221), emission=RGB(66, 48, 66), shine=0.5, specular=RGB(255, 255, 255), transparency=0})
