# Grasshopper definition Nozzles_design.gh (Grasshopper 1.0.7)
# plug-ins: Octopus

# ---- group: End Shaper [Circle]
cir = Circle(Plane=PlaneXY(0, 0, 0), Radius=Slider(3, range=0..100))
divide = DivideCurve(Curve=cir, Count=Slider(3, range=3..30), Kinks=False)  # -> Points, Tangents, Parameters
toggle = BooleanToggle(True)
pline = PolyLine(Vertices=divide.Points, Closed=toggle)
intcrv = Interpolate(Vertices=divide.Points, Degree=3, Periodic=toggle, KnotStyle=1)  # -> Curve, Length, Domain
fillet = Fillet(Curve=pline, Radius=Slider(0.5, range=0..1))

# ---- group: End Shaper [Polygon]
number_slider = Slider(8, range=3..10)
number_slider_2 = Slider(14, range=10..100)
depth = Slider(10.801, range=0..100)
fillet_2 = Slider(1, range=0..1)
polygon = Polygon(Plane=PlaneXY(0, 0, 0), Radius=number_slider_2, Segments=number_slider, FilletRadius=0)  # -> Polygon, Length
neg = Negative(Value=depth)
disc = Discontinuity(Curve=polygon.Polygon, Level=1)  # -> Points, Parameters
dispatch = Dispatch(List=disc.Points, DispatchPattern=[True, False])  # -> ListA, ListB
amp = Amplitude(Vector=dispatch.ListA, Amplitude=neg)
move = Move(Geometry=dispatch.ListA, Motion=amp)  # -> Geometry, Transform
weave = Weave(Pattern=[0, 1], Stream0=move.Geometry, Stream1=dispatch.ListB, NullGaps=False)
pline_2 = PolyLine(Vertices=weave, Closed=Toggle(True))
fillet_3 = Fillet(Curve=pline_2, Radius=fillet_2)

# ----
number_slider_3 = Slider(6, range=0..100)
number_slider_4 = Slider(68, range=0..100)
addition = Addition(A=number_slider_4, B=Slider(25, range=0..100))
cir_2 = Circle(Plane=PlaneXY(0, 0, 0), Radius=number_slider_3)
Z = UnitZ(Factor=number_slider_4)
Z_2 = UnitZ(Factor=addition)
cir_3 = Circle(Plane=PlaneXY(0, 0, 0), Radius=number_slider_3)
move_2 = Move(Geometry=cir_3, Motion=Z)  # -> Geometry, Transform
move_3 = Move(Geometry=cir_2, Motion=Z_2)  # -> Geometry, Transform

# ---- group: Offset
neg_2 = Negative(Value=Slider(0.4, range=0..10))
offset = OffsetCurve(Distance=neg_2, Corners=1)

# ----
octopus = Octopus(OctopusData_gene=[number_slider, depth, number_slider_2], OctopusData_obj=num)

# ---- group: Final Inner Surface
merge = Merge(Data1=move_2.Geometry, Data2=fillet_3)
loft = Loft(Curves=flatten(merge), Options={Adjust=False, Closed=False, LoftEnds=0, LoftSimp=0, LoftType=0, Rebuild=10, Refit=0.01})

# ----
area = Area(Geometry=fillet_3)  # -> Area, Centroid
area_2 = Area(Geometry=cir_3)  # -> Area, Centroid
int = Integer(area.Area)
int_2 = Integer(area_2.Area)
loft_2 = Loft(
    Curves=[move_2.Geometry, move_3.Geometry],
    Options={Adjust=False, Closed=False, LoftEnds=0, LoftSimp=0, LoftType=0, Rebuild=10, Refit=0.01})
subtraction = Subtraction(A=int, B=int_2)
join = BrepJoin(Breps=[loft, loft_2])  # -> Breps, Closed
abs = Absolute(Value=subtraction)
num = Number(abs)
mesh = Mesh(join.Breps)  # disabled
preview = CustomPreview(Geometry=join.Breps, Material=ColourSwatch(SwatchColor=RGB(227, 125, 125)))
var_area = Panel(num)
target_area = Panel(int_2)
subdmesh = SubDFromMesh(Mesh=mesh, Creases=2, Corners=1, Interpolate=False)
