# Grasshopper definition PulleyGenerator_azam.gh (Grasshopper 1.0.7)

# ---- group: Hinge Generator
teeth_width = Slider(0.45, range=0..100)
number_slider = Slider(1, range=0..100)
neg = Negative(Value=teeth_width)
neg_2 = Negative(Value=number_slider)
xy = XYPlane(Origin=Point(0, 0, 0))
pt = ConstructPoint(XCoordinate=neg, YCoordinate=neg_2, ZCoordinate=0)
pt_2 = ConstructPoint(XCoordinate=teeth_width, YCoordinate=number_slider, ZCoordinate=0)
cir = Circle(Plane=xy, Radius=Slider(8, range=0..100))
ellipse = Ellipse(Plane=xy, Radius1=Slider(3, range=0..100), Radius2=Slider(8, range=0..300))  # -> Ellipse, Focus1, Focus2
rec_2pt = Rectangle2Pt(Plane=xy, PointA=pt, PointB=pt_2, Radius=Slider(0.798, range=0..100))  # -> Rectangle, Length
curvepoint = PointOnCurve(cir, parameter=1)
Y = UnitY(Factor=curvepoint)
panel = Panel("Elliptical Hinges")
panel_2 = Panel("Rectengular Hinges")
elliptical_hinges = Move(Geometry=ellipse.Ellipse, Motion=Y)  # -> Geometry, Transform
move = Move(Geometry=rec_2pt.Rectangle, Motion=Y)  # -> Geometry, Transform
arrpolar = PolarArray(Geometry=move.Geometry, Plane=PlaneXY(0, 0, 0), Count=Slider(30, range=0..100), Angle=6.283185307)  # -> Geometry, Transform
trim = TrimWithRegions(Curve=cir, Regions=arrpolar.Geometry)  # -> Inside, Outside
trim_2 = TrimWithRegions(Curve=arrpolar.Geometry, Regions=cir)  # -> Inside, Outside
geo = Geometry(trim_2.Outside)
geo_2 = Geometry(trim.Outside)

# ----
bottom_top_diam = Slider(15, range=0..100)
hole_radius = Slider(6.5, range=0..100)
height_of_pulley = Slider(21, range=0..100)
join = JoinCurves(Curves=flatten([geo, geo_2]), Preserve=False)
xy_2 = XYPlane(Origin=Point(0, 0, 0))
xy_3 = XYPlane(Origin=Point(0, 0, 0))
Z = UnitZ(Factor=height_of_pulley)
extr = Extrude(Base=join, Direction=Z)  # disabled
cir_2 = Circle(Plane=xy_2, Radius=bottom_top_diam)
Z_2 = UnitZ(Factor=Slider(3, range=0..100))
cir_3 = Circle(Plane=xy_3, Radius=hole_radius)
cap = CapHoles(Brep=extr)
extr_2 = Extrude(Base=cir_2, Direction=Z_2)  # disabled
Z_3 = UnitZ(Factor=height_of_pulley)
cap_2 = CapHoles(Brep=extr_2)
extr_3 = Extrude(Base=cir_3, Direction=Z_3)  # disabled
move_2 = Move(Geometry=cap_2, Motion=Z_3)  # -> Geometry, Transform
cap_3 = CapHoles(Brep=extr_3)
scale_nu = ScaleNU(Geometry=cap_3, Plane=PlaneXY(0, 0, 0), ScaleX=1, ScaleY=1, ScaleZ=Slider(1.8, range=0..10))  # -> Geometry, Transform
sunion = SolidUnion(Breps=[cap, move_2.Geometry, cap_2])
sdiff = SolidDifference(BrepsA=sunion, BrepsB=flatten(scale_nu.Geometry))  # -> flatten(Result)
sunion_2 = SolidUnion(Breps=sdiff)
