# Grasshopper definition SLA_Nozzle_design.gh (Grasshopper 1.0.7)
# plug-ins: Pufferfish

number_slider = Slider(5, range=0..100)
number_slider_2 = Slider(24, range=0..100)
division = Division(A=number_slider_2, B="2")
division_2 = Division(A=number_slider, B="2")
neg = Negative(Value=division)
neg_2 = Negative(Value=division_2)
paramsubdivsrf = ParameterSubdivideSurface(ParametersU=[0, 0.25, 0.5, 0.75, 1], ParametersV=[0, 0.25, 0.5, 0.75, 1])
pt = ConstructPoint(XCoordinate=0, YCoordinate=neg_2, ZCoordinate=0)
pt_2 = ConstructPoint(XCoordinate=neg, YCoordinate=0, ZCoordinate=0)
rectangle = Rectangle(Plane=pt_2, XSize=number_slider_2, YSize=number_slider, Radius=0)  # -> Rectangle, Length
Z = UnitZ(Factor=Slider(40, range=0..100))
cir = Circle(Plane=PlaneXY(0, 0, 0), Radius=Slider(7.5, range=0..100))
move = Move(Geometry=rectangle.Rectangle, Motion=Z)  # -> Geometry, Transform
area = Area(Geometry=[cir, move.Geometry])  # -> Area, Centroid
panel = Panel(area.Area)

# ---- group: Curve Morphing
python = GhPythonScript(N=Slider(13, range=0..100), R=Slider(17.5, range=0..100))  # -> np, points; inputs N: Int32; disabled
# ---------- python: Python ----------
import Rhino.Geometry as rg
import math
import random as rnd
import rhinoscriptsyntax as rs


points = []
np = 0
for j in rs.frange(0, 2*math.pi, math.pi/N):
    point = rg.Point3d(math.sin(j) * R, math.cos(j) * R, 0)
    points.append(point)
    np+=1
# ---------- end python ----------
rectangle_2 = Rectangle(Plane=PlaneXY(0, 0, 0), XSize="{-20,20}", YSize="{-20,20}", Radius=0)  # -> Rectangle, Length; disabled
divide = DivideCurve(Curve=rectangle_2.Rectangle, Count=python.np, Kinks=False)  # -> Points, Tangents, Parameters
shift = ShiftList(List=divide.Points, Shift=Slider(18, range=0..100), Wrap=True)
rev = ReverseList(List=shift)
timer = Timer(Interval=20, TimerInterval=20, Target=python_2)  # disabled
python_2 = GhPythonScript(ACTIVE=Toggle(False), rect_pts=rev, circ_pts=python.points)  # -> out, a; inputs ACTIVE: Boolean, rect_pts: list of Point3d, circ_pts: list of Point3d
# ---------- python_2: Python ----------
import Rhino.Geometry as rg
import scriptcontext as sc

if not ACTIVE:
    sc.sticky["t"] = 0.0
else:
    sc.sticky["t"] += 0.015 

a = []
for i, pt in enumerate(circ_pts):
    rect_pts[i].Interpolate(pt, rect_pts[i], sc.sticky["t"])
    a.append(rect_pts[i])
# ---------- end python_2 ----------
intcrv = Interpolate(Vertices=python_2.a, Degree=3, Periodic=True, KnotStyle=1)  # -> Curve, Length, Domain

# ----
tweencrv = TweenCurve(CurveA=cir, CurveB=move.Geometry, Factor=0.5, BlendType=0)
